# Dynamo graph auto_Equipment Instance Generator-0,0-base.dyn "Equipment Instance Generator-0,0-base" (Dynamo 2.12.0.5650)

# group: FUNCTION
# note: Data manipulation on dynamo objects

# group: OUTPUT
# note: Object creation in Revit or Data output for Generative Design

# group: CREATION
# note: Dynamo objects or data created inside of dynamo

# group: GET
# note: Get parameter values from Revit/Formit objects

# group: Equipment Instance Generator
# note: NOTES
# This graph is the 2nd of 2 graphs for equipment generation. This graph creates instances of scalable box families for all equipment represented in the Excel spreadsheet.
# note: DESCRIPTION
# The purpose of this graph is to create a scalable box family per row of equipment in the Excel spreadsheet. Ensure information is correctly formatted in Excel, set all user inputs, and the parking lot of equipment will be generated in your model.
# note: PACKAGES
# note: INSTRUCTIONS
# 1) Ensure you have completed and saved your Excel file
# 2) Define the file path of your Excel file and the Sheet name
# 3) Ensure the scalable box family has been loaded into your Revit model and select it in the appropriate node.
# 4) Run the script
# note: AUTHOR DATE and/or PROJECT
# Ali Nasiri 2022
# note: KNOWN ISSUES

# group: SET
# note: Set parameter values of Revit/Formit objects

# group: INPUT
# note: Data input and preparation

# group: DEBUG
# note: Nodes used to debug the graph logic

# group: WIP
# note: Notes not considered part of the final package

# group: USER INPUT
# note: Object creation in Revit or Data output for Generative Design

# group: Select Scalable Box Family
code_block = CodeBlock { "F-QEQMT-Scalable Box - Dashed- Dynamo"; }

# group: Define Excel info
file_path = Filename("xlsxs\By Department\z-other stuff 20-04-14.xlsx")  # graph input
sheet_name = StringInput("ASF Lab Assets DRAFT V5")  # graph input

# group: Get Excel Data
file_from_path = FileObject(path=file_path)
importExcel = Data.ImportExcel(file=file_from_path, sheetName=sheet_name)
transpose = List.Transpose(lists=importExcel)

# group: Set Column Index
excel_columns = CodeBlock(equipmentType=transpose) { equipmentType[2]; }

# group (continued): Get Excel Data
restOfItems = List.RestOfItems(list=excel_columns)
watch = Watch(restOfItems)

# group: Family Type Names
byFamilyNameAndTypeName = FamilyType.ByFamilyNameAndTypeName(familyName=code_block, typeName=watch)

# group: BOX LOCATIONS
count = List.Count(list=byFamilyNameAndTypeName)
sqrt = Math.Sqrt(number=count)
code_block_2 = CodeBlock { 0; }
round = Math.Round(number=sqrt, digits=code_block_2)
code_block_3 = CodeBlock { 1; }
add = round + code_block_3
code_block_4 = CodeBlock { 10; }
mul = add * code_block_4
range = Range(end=mul, step=code_block_4)
range_2 = Range(end=mul, step=code_block_4)
byCoordinates = Point.ByCoordinates(x=range, y=range_2, lacing=CrossProduct)
flatten = List.Flatten(list=byCoordinates)
code_block_5 = CodeBlock { 0; }
slice = List.Slice(list=flatten, start=code_block_5, end=count)

# group: MOVE TO LOCATIONS
levels = Levels("Level 1")
byPointAndLevel = FamilyInstance.ByPointAndLevel(familyType=byFamilyNameAndTypeName, point=slice, level=levels)

# group: ADD INSTANCE PARAMETERS
setParameterByName = Element.SetParameterByName(element=byPointAndLevel)  # unwired: parameterName, value
code_block_6 = CodeBlock(prameters=importExcel) { prameters[0]; }
watch_2 = Watch(code_block_6)
restOfItems_2 = List.RestOfItems(list=importExcel)
transpose_2 = List.Transpose(lists=restOfItems_2)
combine = List.Combine(comb=setParameterByName, list1=watch_2, list2=transpose_2)
