# Dynamo graph auto_Equipment Type Generator.dyn (Dynamo 2.12.0.5650)
# packages: Clockwork for Dynamo 2.x 2.3.0

# group: FUNCTION
# note: Data manipulation on dynamo objects

# group: GET
# note: Get parameter values from Revit/Formit objects

# group: CREATION
# note: Dynamo objects or data created inside of dynamo

# group: INPUT
# note: Data input and preparation

# group: OUTPUT
# note: Object creation in Revit or Data output for Generative Design

# group: SET
# note: Set parameter values of Revit/Formit objects

# group: DEBUG
# note: Nodes used to debug the graph logic

# group: WIP
# note: Notes not considered part of the final package

# group: USER INPUT
# note: Object creation in Revit or Data output for Generative Design

# group: Copy this group and the color system to your graph and fill in the information (Replace this text with a Title)
# note: NOTES
# This graph is the 1st of 2 graphs for equipment generation. This graph creates types of the scalable box family for all equipment represented in the Excel spreadsheet.
# note: PACKAGES
# Clockwork for Dynamo 2.x
# DynamoIronPython2.7
# note: DESCRIPTION
# The purpose of this graph is to create family types of the scalable box that represent groups of like equipment. Depending on how you setup the Excel file, this graph will look for like items in a specified column and create appropriate types.
# note: INSTRUCTIONS
# 1) Make sure your Excel spreadsheet is setup appropriately and saved.
# 2) Input the user inputs for file path and sheet name.
# 3) Make sure the scalable box family has been loaded into your model so you can specify it in the family selection user input.
# 2) Run the graph
# note: AUTHOR DATE and/or PROJECT
# Ali Nasiri 2022
# note: KNOWN ISSUES

# group: Excel Path
file_path = Filename("Final Test\xlsxs\Types 20-04-14.xlsx")  # graph input
sheet_name = StringInput("ASF Lab Assets DRAFT V5")  # graph input

# group: Get Excel Data
file_from_path = FileObject(path=file_path)
importExcel = Data.ImportExcel(file=file_from_path, sheetName=sheet_name)
transpose = List.Transpose(lists=importExcel)
excel_cells = CodeBlock(equipmentType=transpose) { equipmentType[0][1]; }
excel_columns = CodeBlock(equipmentType=transpose, equipmentTagName=transpose) { equipmentType[1]; equipmentTagName[0]; }

# group: Select Scalable Box Family
family_types = FamilyTypes("F-QEQMT-Scalable Box - Dashed- Dynamo:DP")  # graph input

# group: CREATING NEW TYPES
watch = Watch(excel_columns.out0)
restOfItems = List.RestOfItems(list=watch)
list_create = List.Create()  # unwired: item0
map = List.Map(list=restOfItems, f_x=list_create)
duplicate = Custom[FamilyType.Duplicate](elementType=family_types, name=map, lacing=CrossProduct)  # package Clockwork for Dynamo 2.x; Duplicates a family type

# group: TYPE PARAMETER SETUP
code_block = CodeBlock { "Equipment Name"; }
watch_2 = Watch(excel_columns.out1)
restOfItems_2 = List.RestOfItems(list=watch_2)
setParameterByName = Element.SetParameterByName(element=duplicate, parameterName=code_block, value=restOfItems_2)
